# Grasshopper definition speed-modulated ironing with UI.gh (Grasshopper 1.0.8)
# plug-ins: Human UI, Human

create_label = CreateLabel(LabelText="preview", LabelSize=Slider(15, range=0..100), Justification=0)
create_toggle = CreateToggle(Default=False)
adjust_element_positioning = AdjustElementPositioning(
    ElementsToAdjust=flatten([create_toggle, create_label]),
    Margin="0, 20, 0, 0",
    AbsolutePositioning=False,
    Width=[Slider(104, range=0..1000), Slider(96, range=0..1000)],
    Height=Slider(53, range=0..100),
    HorizontalAlignment=1,
    VerticalAlignment=1)
value_listener = ValueListener(Elements=create_toggle, SomeProperty=True)  # -> Values, Indices
merge = Merge(Data1=flatten(create_label), Data2=flatten(create_toggle))
create_stack = CreateStack(UIElements=merge, Horizontal=True)
adjust_element_positioning_2 = AdjustElementPositioning(ElementsToAdjust=create_stack, AbsolutePositioning=False, HorizontalAlignment=1)

# ---- group: Advanced Settings
high_speed = Slider(20, range=0..100)
low_speed = Slider(1, range=0..10)

create_label_2 = CreateLabel(LabelText="Ironing speed interval (mm/s)", LabelSize=12, Justification=0)
create_slider = CreateSlider(Slider=low_speed, SnapValue=0, ShowBounds=False, ShowTicks=False, ShowTooltip=False, ShowValLabel=True, showLabel=True)
create_slider_2 = CreateSlider(Slider=high_speed, SnapValue=0, ShowBounds=False, ShowTicks=False, ShowTooltip=False, ShowValLabel=True, showLabel=True)
merge_2 = Merge(Data1=flatten(create_label_2), Data2=flatten(create_slider), Data3=flatten(create_slider_2))

# ----
create_label_3 = CreateLabel(LabelText="enable advanced settings", LabelSize=Slider(16, range=0..100), Justification=0)
create_toggle_2 = CreateToggle(Default=False)
adjust_element_positioning_3 = AdjustElementPositioning(
    ElementsToAdjust=flatten([create_toggle_2, create_label_3]),
    Margin="0, 5, 0, -10",
    AbsolutePositioning=False,
    Width=[Slider(90, range=0..1000), Slider(190, range=0..1000)],
    Height=Slider(57, range=0..100),
    HorizontalAlignment=1,
    VerticalAlignment=1)
value_listener_2 = ValueListener(Elements=create_toggle_2, SomeProperty=True)  # -> Values, Indices
merge_3 = Merge(Data1=flatten(create_label_3), Data2=flatten(create_toggle_2))
create_stack_2 = CreateStack(UIElements=merge_3, Horizontal=True)

# ---- group: texture mode
panel_2 = Panel("""Image projection
Textured OBJ""")
panel_3 = Panel("""True
False""")
create_radio_button = CreateRadioButton(RadioButtonName=panel_2, RadioButtonGroup="mode", InitiallySelected=panel_3)
value_listener_3 = ValueListener(Elements=create_radio_button, SomeProperty=True)  # -> Values, Indices
adjust_element_positioning_4 = AdjustElementPositioning(ElementsToAdjust=create_radio_button, Margin="5, 10, 20, 10", AbsolutePositioning=False, HorizontalAlignment=3)
create_stack_3 = CreateStack(UIElements=flatten(create_radio_button), Horizontal=Toggle(True))

# ---- group: Gcode name
create_text_box = CreateTextBox(Label="File name", DefaultText="--type output Gcode file name here--", UpdateButton=False, showLabel=True)
adjust_element_positioning_5 = AdjustElementPositioning(
    ElementsToAdjust=create_text_box,
    Margin="0, 0, 0, 10",
    AbsolutePositioning=False,
    Width=Slider(276, range=0..1000),
    HorizontalAlignment=1)
value_listener_4 = ValueListener(Elements=create_text_box, SomeProperty=True)  # -> Values, Indices

# ---- group: Project directory
create_file_picker = CreateFilePicker(ButtonLabelText="Project directory", DialogType=2, MustExist=True, Filter="All Files|*.*")
number_slider = Slider(250, range=0..1000)
value_listener_5 = ValueListener(Elements=create_file_picker, SomeProperty=True)  # -> Values, Indices
adjust_element_positioning_6 = AdjustElementPositioning(
    ElementsToAdjust=create_file_picker,
    Margin="0, 10, 0, 0",
    AbsolutePositioning=False,
    Height=Slider(34, range=0..100),
    HorizontalAlignment=3)
directory_contents = DirectoryContents(x=value_listener_5.Values)  # -> out, A; inputs x: String
# ---------- directory_contents: C# ----------
   A= Directory.EnumerateFiles(x);
# ---------- end directory_contents ----------

# ---- group: Visualized image
create_image = CreateImage(
    ImageSource="\\Mac\Home\Library\CloudStorage\OneDrive-DelftUniversityofTechnology\ironing\figures\UI\placeholder@3x.png",
    ImageWidth=Slider(360, range=0..1000))
number_slider_2 = Slider(220, range=0..1000)
adjust_element_positioning_7 = AdjustElementPositioning(
    ElementsToAdjust=create_image,
    Margin="0, 0, 0, 0",
    AbsolutePositioning=False,
    HorizontalAlignment=1,
    VerticalAlignment=1)

# ---- group: Material selection
panel_4 = Panel("""LW-PLA
Corkfill
Woodfill
Other""")
create_pulldown_menu = CreatePulldownMenu(Label="material", ListItems=flatten(panel_4), showLabel=True)

adjust_element_positioning_8 = AdjustElementPositioning(
    ElementsToAdjust=create_pulldown_menu,
    Margin="0, 20, 20, 10",
    AbsolutePositioning=False,
    Width=Slider(200, range=0..1000),
    HorizontalAlignment=3,
    VerticalAlignment=1)
value_listener_6 = ValueListener(Elements=create_pulldown_menu, SomeProperty=True)  # -> Values, Indices

# ----
directory_contents_2 = DirectoryContents(x="\\Mac\Home\Desktop\faces")  # -> out, A; inputs x: String; same code as directory_contents
create_pulldown_menu_2 = CreatePulldownMenu(Label="Texture image", ListItems=flatten(directory_contents_2.A), showLabel=True)
number_slider_3 = Slider(250, range=0..1000)
value_listener_7 = ValueListener(Elements=create_pulldown_menu_2, SomeProperty=True)  # -> Values, Indices
adjust_element_positioning_9 = AdjustElementPositioning(ElementsToAdjust=create_pulldown_menu_2, Margin="0, 0, 0, 10", AbsolutePositioning=False, HorizontalAlignment=3)

# ---- group: Generate gcode button
create_button = CreateButton(ButtonName="generate gcode", ButtonStyle=0)
value_listener_8 = ValueListener(Elements=create_button, SomeProperty=True)  # -> Values, Indices

# ---- group: Gcode generated message
panel_5 = Panel()
sift_pattern = SiftPattern(List="gcode generated!", SiftPattern=value_listener_8.Values)  # -> Output0, Output1
create_text_block = CreateTextBlock(Text=panel_5, TextSize=12, Justification=0)
stream_filter = StreamFilter(Gate=value_listener_8.Values, Stream0=" ", Stream1="gcode generated!")
combine_data = CombineData(Input0=" ", Input1=sift_pattern.Output1)  # -> Result, Index
adjust_element_positioning_10 = AdjustElementPositioning(ElementsToAdjust=create_text_block, AbsolutePositioning=False, HorizontalAlignment=1)
set_textblock_contents = SetTextBlockContents(TextBlockToModify=create_text_block, NewTextBlockContents=stream_filter)

# ----
text = Text(value_listener_4.Values)
set_image = SetImage(ImageToModify=flatten(create_image), NewImagePath=value_listener_7.Values)
list_item = ListItem(List=flatten(value_listener_3.Values), Index=1, Wrap=True)
set_list_contents = SetListContents(ListToModify=flatten(create_pulldown_menu_2), NewListContents=directory_contents.A)
panel_6 = Panel(value_listener_5.Values)
adjust_element_positioning_11 = AdjustElementPositioning(ElementsToAdjust=create_stack_3, AbsolutePositioning=False, HorizontalAlignment=1)

# ---- group: Layout / Seperators
colour_picker = ColourPicker(PickedColour=RGB(189, 189, 189))
create_separator = CreateSeparator(Thickness=1, Horizontal=True, Color=colour_picker)
create_separator_2 = CreateSeparator(Thickness=1, Horizontal=True, Color=colour_picker)
create_separator_3 = CreateSeparator(Thickness=1, Horizontal=True, Color=colour_picker)
adjust_element_positioning_12 = AdjustElementPositioning(ElementsToAdjust=create_separator_3, Margin="0, 0, 0, 10", AbsolutePositioning=False)

# ---- group: Layout
launch_window = LaunchWindow(
    Show=Toggle(True),
    Name="UIron",
    Width=Slider(360, range=0..10000),
    Height=Slider(780, range=0..10000),
    ChildStatus=0,
    EnableHorizScroll=False)

# ----
z_jump_at_nozzle_switch_mm = Slider(3, range=0..10)
ironing_acceleration = Slider(5000, range=0..10000)
ironing_jerk = Slider(40, range=0..100)

# ---- group: Advanced Settings
retraction_length = Slider(10, range=0..10)
retration_speed = Slider(1500, range=0..10000)

high_speed_2 = Slider(40, range=0..100)
low_speed_2 = Slider(1, range=0..10)

z_offset = Slider(0.1, range=0..1)
x_offset = Slider(-18, range=-22..22)

# ----
# pick the directory
# with all input files
method = ValueList({"Projection": 0, "OBJ": 1}, selected="OBJ")
material = ValueList({"LW-PLA": 0, "Corkfill": 1, "Woodfill": 2}, selected="Woodfill")
output_gcode_name = Panel(text)
core_0 = ValueList({"AA 0.4", "BB 0.4", "AA 0.8", "BB 0.8"}, selected="AA 0.4")
core_1 = ValueList({"AA 0.4", "BB 0.4", "AA 0.8", "BB 0.8"}, selected="AA 0.4")
source_files_directory = FilePath(value_listener_5.Values)

merge_4 = Merge(Data1=ironing_acceleration, Data2=ironing_jerk, Data3=z_jump_at_nozzle_switch_mm)  # -> simplify(graft(Result))

# ----
# Click to generate and
# save the Gcode file
generate_gcode = Button()

# ----
# set “True” to
# enable preview
preview = BooleanToggle(True)

# ---- group: Advanced Settings
ironing_acceleration_2 = Slider(5000, range=0..10000)
z_jump_at_nozzle_switch_mm_2 = Slider(3, range=0..10)
ironing_jerk_2 = Slider(40, range=0..100)
bed_temperature = Slider(60, range=20..100)
printing_nozzle_temperature = Slider(205, range=150..350)
standby_temperature = Slider(175, range=150..350)
retraction_length_2 = Slider(15, range=0..20)
retraction_speed = Slider(1500, range=0..10000)
heatingtime = Slider(5, range=0..10)
create_slider_3 = CreateSlider(Slider=ironing_acceleration_2, ShowBounds=False, ShowTicks=False, ShowTooltip=False, ShowValLabel=True, showLabel=True)
create_slider_4 = CreateSlider(Slider=ironing_jerk_2, ShowBounds=False, ShowTicks=False, ShowTooltip=False, ShowValLabel=True, showLabel=True)
create_slider_5 = CreateSlider(
    Slider=printing_nozzle_temperature,
    SnapValue=0,
    ShowBounds=False,
    ShowTicks=False,
    ShowTooltip=False,
    ShowValLabel=True,
    showLabel=True)
create_slider_6 = CreateSlider(Slider=heatingtime, SnapValue=0, ShowBounds=False, ShowTicks=False, ShowTooltip=False, ShowValLabel=True, showLabel=True)
create_slider_7 = CreateSlider(
    Slider=standby_temperature,
    SnapValue=0,
    ShowBounds=False,
    ShowTicks=False,
    ShowTooltip=False,
    ShowValLabel=True,
    showLabel=True)
create_slider_8 = CreateSlider(
    Slider=bed_temperature,
    SnapValue=0,
    ShowBounds=False,
    ShowTicks=False,
    ShowTooltip=False,
    ShowValLabel=True,
    showLabel=True)
create_slider_9 = CreateSlider(
    Slider=retraction_length_2,
    SnapValue=0,
    ShowBounds=False,
    ShowTicks=False,
    ShowTooltip=False,
    ShowValLabel=True,
    showLabel=True)
create_slider_10 = CreateSlider(
    Slider=retraction_speed,
    SnapValue=0,
    ShowBounds=False,
    ShowTicks=False,
    ShowTooltip=False,
    ShowValLabel=True,
    showLabel=True)
create_slider_11 = CreateSlider(
    Slider=z_jump_at_nozzle_switch_mm_2,
    SnapValue=0,
    ShowBounds=False,
    ShowTicks=False,
    ShowTooltip=False,
    ShowValLabel=True,
    showLabel=True)
merge_5 = Merge(
    Data1=flatten(create_slider_5),
    Data2=flatten(create_slider_7),
    Data3=flatten(create_slider_6),
    Data4=flatten(create_slider_8),
    Data5=flatten(create_slider_9),
    Data6=flatten(create_slider_10),
    Data7=flatten(create_slider_11))
create_expander = CreateExpander(UIElements=flatten(merge_5), Header="Print Settings", Open=True)
merge_6 = Merge(Data1=create_slider_3, Data2=create_slider_4, Data3=create_slider_11)
value_listener_9 = ValueListener(Elements=merge_6, SomeProperty=True)  # -> Values, Indices

ironing_nozzle_temperature = Slider(330, range=200..400)
sampling_length = Slider(0.2, range=0.1..10)
z_offset_2 = Slider(0, range=0..1)
create_slider_12 = CreateSlider(
    Slider=sampling_length,
    SnapValue=0,
    ShowBounds=False,
    ShowTicks=False,
    ShowTooltip=False,
    ShowValLabel=True,
    showLabel=True)
create_slider_13 = CreateSlider(
    Slider=ironing_nozzle_temperature,
    SnapValue=0,
    ShowBounds=False,
    ShowTicks=False,
    ShowTooltip=False,
    ShowValLabel=True,
    showLabel=True)
create_slider_14 = CreateSlider(Slider=z_offset_2, SnapValue=0, ShowBounds=False, ShowTicks=False, ShowTooltip=False, ShowValLabel=True, showLabel=True)
merge_7 = Merge(
    Data1=flatten(create_slider_12),
    Data2=flatten(create_slider_13),
    Data3=flatten(create_slider_14),
    Data4=flatten(merge_2),
    Data5=flatten(create_slider_3),
    Data6=flatten(create_slider_4))

create_expander_2 = CreateExpander(UIElements=flatten(merge_7), Header="Ironing settings", Open=True)
merge_8 = Merge(
    Data1=create_slider_12,
    Data2=create_slider_13,
    Data3=create_slider_14,
    Data4=create_slider,
    Data5=create_slider_2,
    Data6=create_slider_5,
    Data7=create_slider_7,
    Data8=create_slider_6,
    Data9=create_slider_8,
    Data10=create_slider_9,
    Data11=create_slider_10)
value_listener_10 = ValueListener(Elements=merge_8, SomeProperty=True)  # -> Values, Indices
adjust_element_positioning_13 = AdjustElementPositioning(ElementsToAdjust=create_expander_2, Margin="0, 0, 0, 10", AbsolutePositioning=False)

# ----
explode_tree = ExplodeTree(Data=value_listener_10.Values)  # -> Branch0, Branch1, Branch2, Branch3, Branch4, Branch5, Branch6, Branch7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

# ---- group: Advanced Settings
# set “True” to enable
# advanced settings
temp_print_nozzle = DigitScroller(Scroller_Digits=12, Scroller_Prefix="Temp Print Nozzle", Scroller_Radix=9, Scroller_Value=195)
temp_ironing_nozzle = DigitScroller(Scroller_Digits=12, Scroller_Prefix="Temp Ironing Nozzle", Scroller_Radix=9, Scroller_Value=300)
bed_temperature_2 = DigitScroller(Scroller_Digits=12, Scroller_Prefix="Bed Temperature", Scroller_Radix=9, Scroller_Value=60)
wait_temp_print_nozzle = DigitScroller(Scroller_Digits=12, Scroller_Prefix="Wait Temp Print Nozzle", Scroller_Radix=9, Scroller_Value=180)
sampling_length_2 = Slider(1, range=0..10)
heatingtime_2 = Slider(5, range=0..10)
advanced_settings = BooleanToggle(False)
merge_9 = Merge(
    Data1=flatten(" (Advanced)"),
    Data2=flatten(explode_tree.Branch5),
    Data3=flatten(explode_tree.Branch1),
    Data4=flatten(explode_tree.Branch8),
    Data5=flatten(explode_tree.Branch6),
    Data6=flatten(explode_tree.Branch0),
    Data7=flatten(explode_tree.Branch3),
    Data8=flatten(explode_tree.Branch4),
    Data9=flatten(x_offset),
    Data10=flatten(explode_tree.Branch2),
    Data11=flatten(explode_tree.Branch9),
    Data12=flatten(explode_tree.Branch10),
    Data13=flatten(explode_tree.Branch7))

# ----
stream_filter_2 = StreamFilter(Gate=value_listener_2.Values, Stream0=merge_4, Stream1=value_listener_9.Values)
explode_tree_2 = ExplodeTree(Data=stream_filter_2)  # -> Branch0, Branch1, Branch2

panel_7 = Panel("""AA 0.4
BB 0.4
AA 0.8
BB 0.8""")

create_pulldown_menu_3 = CreatePulldownMenu(Label="Print Core 1", ListItems=flatten(panel_7), SelectedIndex=0, showLabel=True)

create_pulldown_menu_4 = CreatePulldownMenu(Label="Print Core 2", ListItems=flatten(panel_7), SelectedIndex=0, showLabel=True)

adjust_element_positioning_14 = AdjustElementPositioning(
    ElementsToAdjust=[create_pulldown_menu_3, create_pulldown_menu_4],
    Margin="0, 15, 20, 20",
    AbsolutePositioning=False,
    Width=Slider(150, range=0..1000),
    HorizontalAlignment=0)
merge_10 = Merge(Data1=flatten(create_pulldown_menu_3), Data2=flatten(create_pulldown_menu_4))
value_listener_11 = ValueListener(Elements=create_pulldown_menu_3, SomeProperty=True)  # -> Values, Indices
value_listener_12 = ValueListener(Elements=create_pulldown_menu_4, SomeProperty=True)  # -> Values, Indices
create_stack_4 = CreateStack(UIElements=merge_10, Horizontal=True)

# ---- group: Layout
merge_11 = Merge(Data1=flatten(create_text_box), Data2=flatten(create_button))
merge_12 = Merge(Data1=flatten(create_image), Data2=flatten(create_pulldown_menu_2), Data3=flatten(create_separator_2))
create_stack_5 = CreateStack(UIElements=flatten(merge_12), Horizontal=Toggle(False))
create_stack_6 = CreateStack(UIElements=flatten(merge_11), Horizontal=Toggle(False))
merge_13 = Merge(
    Data1=flatten(create_separator),
    Data2=flatten(create_pulldown_menu),
    Data3=flatten(create_stack_3),
    Data4=flatten(create_file_picker),
    Data5=flatten(create_stack_5),
    Data6=flatten(create_stack),
    Data7=flatten(create_stack_6),
    Data8=flatten(create_text_block))
panel_8 = Panel("""Speed-Modulated Ironing
Advanced Settings""")
merge_14 = Merge(
    Data1=flatten(create_separator_3),
    Data2=flatten(create_stack_4),
    Data3=flatten(create_stack_2),
    Data5=flatten(create_expander_2),
    Data6=flatten(create_expander))
tabbed_view = TabbedView(TabNames=flatten(panel_8), TabTextSize=Slider(15, range=0..100), Tab0=flatten(merge_13), Tab1=flatten(merge_14))
add_elements = AddElements(Window=launch_window, Elements=flatten(tabbed_view), DoVLChecking=True)  # -> AddedElements, ElementNames

# ----
ironing_settings = IroningSettings(advanced_settings_toggle=value_listener_2.Values, material=value_listener_6.Indices, advanced_settings=merge_9)  # -> print_temperature_2, ironing_temperature_2, bed_temperature_2, print_nozzle_wait_temperature_2, sampling_length_2, ironing_speed_low_2, ironing_speed_high_2, zoffset_2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
cluster = Cluster_3(
    directory=source_files_directory,
    extruder0name=value_listener_11.Values,
    extruder1name=value_listener_12.Values,
    temp0=ironing_settings.print_temperature_2,
    temp1=ironing_settings.ironing_temperature_2,
    tempbed=ironing_settings.bed_temperature_2,
    sampling_length=ironing_settings.sampling_length_2)  # -> header, newgcode, gcodepath_2, nonmesh_layers, threemf, footer, obj, texture, points, output_header
cluster_2 = Cluster_2(
    method=list_item,
    material=value_listener_6.Indices,
    _3mfpath=cluster.threemf,
    objpath=cluster.obj,
    imagepath=value_listener_7.Values,
    gcodepath=cluster.gcodepath_2,
    points=cluster.points)
cluster_3 = Cluster_4(color_mapping=cluster_2, generate_gcode=value_listener_8.Values)  # -> branch, count, cull_pattern_2
remove_no_ironing_layers = RemoveNoIroningLayers(
    points=cluster.points,
    input_list=cluster.header,
    cull_pattern=cluster_3.cull_pattern_2,
    generate_gcode=value_listener_8.Values)  # -> points_with_x_offset, X_2, Y, Z, machine_abbreviation, count
retraction = Retraction(tree=cluster.newgcode, cull_pattern=cluster_3.cull_pattern_2)

# ---- group: Preview
preview_2 = Preview(ironing_points=cluster.points, gate=value_listener.Values, material=value_listener_6.Indices, color_mapping=cluster_2)  # -> L, C
custom_preview_lineweights = CustomPreviewLineweights(Geometry=preview_2.L, Shader=preview_2.C, Thickness=Slider(0.4, range=0..1), Absolute=True)

# ----
switch_to_ironing_nozzle = SwitchToIroningNozzle(
    wait_temp=ironing_settings.print_nozzle_wait_temperature_2,
    e_value=retraction,
    retraction_speed=ironing_settings.retractionspeed_2,
    retraction_length=ironing_settings.retractionlength_2,
    points_with_x_offset=remove_no_ironing_layers.points_with_x_offset,
    z_value=remove_no_ironing_layers.Z,
    z_offset=ironing_settings.zoffset_2,
    z_jump=explode_tree_2.Branch2,
    acceleration=explode_tree_2.Branch0,
    jerk=explode_tree_2.Branch1,
    L=remove_no_ironing_layers.count)
switch_to_printing = SwitchToPrinting(nonmesh_layers=cluster.nonmesh_layers, e_value=retraction, cull_pattern=cluster_3.cull_pattern_2, L=cluster_3.count)
ironing = Ironing(
    brightness_values=cluster_3.branch,
    low_speed=ironing_settings.ironing_speed_low_2,
    high_speed=ironing_settings.ironing_speed_high_2,
    x_value=remove_no_ironing_layers.X_2,
    y_value=remove_no_ironing_layers.Y,
    z_value=remove_no_ironing_layers.Z,
    z_offset=ironing_settings.zoffset_2,
    segment_length=ironing_settings.sampling_length_2,
    heating_time=ironing_settings.print_nozzle_preheating_time_2,
    print_temp=ironing_settings.print_temperature_2,
    L=cluster_3.count)

merge_printing_and_ironing = Merge(
    Data1=simplify(cluster.newgcode),
    Data2=simplify(switch_to_ironing_nozzle),
    Data3=simplify(ironing),
    Data4=simplify(switch_to_printing))
add_header_and_footer = Merge(Data1=flatten(cluster.output_header), Data2=flatten(merge_printing_and_ironing), Data3=flatten(cluster.footer))
save_gcode_file = SaveGcodeFile(
    combined_gcode=add_header_and_footer,
    generate_gcode=value_listener_8.Values,
    directorypath=source_files_directory,
    material=value_listener_6.Indices,
    printer_name=remove_no_ironing_layers.machine_abbreviation,
    gcode_name=output_gcode_name)
panel_9 = Panel(save_gcode_file)

# ----
# confirmation for the
# generated gcode file
confirmation_message = Panel(panel_9)

# ==== cluster Preview
sddp = ShapeDiverDocumentPayload({AbsoluteTolerance=0, AngleTolerance=0, DistanceDisplayPrecision=0, GltfVersion="Gltf2", GrasshopperVersion="1.0.0008", InputGroups="{}", OutputGroups="{}", RelativeTolerance=0, RhinoVersion="8.5.24072.13001", UnitSystem=0, VersionCreated="1.20.0.0", VersionSaved="1.20.0.0"})
gate = ClusterInput()
color_mapping = ClusterInput()
ironing_points = ClusterInput()
material = ClusterInput()
stream_gate = StreamGate(IroningPoints=ironing_points, Gate=gate)  # -> Target0, Target1
stream_gate_2 = StreamGate(ColorMapping=color_mapping, Gate=gate)  # -> Target0, Target1
stream_gate_3 = StreamGate(Material=material, Gate=gate)  # -> Target0, Target1
construct_point = ConstructPoint(XCoordinate="116.5", YCoordinate="107.5", ZCoordinate="0")
construct_point_2 = ConstructPoint(XCoordinate="0", YCoordinate="0", ZCoordinate="0")
vector_2pt = Vector2Pt(PointA=construct_point, PointB=construct_point_2, Unitize=False)  # -> Vector, Length
panel = Panel("""1
0""")
repeat = RepeatData(Data=Slider(0, range=0..100), Length=Slider(1, range=0..10))
merge = Merge(Data1=Slider(1, range=0..100), Data2=repeat)  # -> flatten(Result)
cluster = Cluster(tree=stream_gate.Target1, cull_pattern=panel)
cull = CullPattern(List=cluster, CullPattern=merge)
move = Move(IroningPoints=cull, Motion=vector_2pt.Vector)  # -> Geometry, Transform

# ---- group: preview
subtraction = Subtraction(A=1, ColorMapping=stream_gate_2.Target1)
filter = StreamFilter(Material=stream_gate_3.Target1, Stream0=subtraction, Stream1=stream_gate_2.Target1, Stream2=stream_gate_2.Target1)
shift = ShiftList(List=move.Geometry, Shift=1, Wrap=True)
ln = Line(StartPoint=move.Geometry, EndPoint=shift)

# ----
cluster_2 = Cluster(tree=filter, cull_pattern=panel)
cull_2 = CullPattern(List=cluster_2, CullPattern=merge)

# ---- group: preview (continued)
remap = RemapNumbers(Value=cull_2, Source=Domain(0, 1), Target=Domain(0.1, 0.8))  # -> Mapped, Clipped
hsv = ColourHSV(Alpha=Slider(1, range=0..1), Hue=0, Saturation=0, Value=remap.Mapped)

# ----
L = ClusterOutput(ln)
C = ClusterOutput(hsv)

# ==== cluster Ironing
segment_length = ClusterInput()
heating_time = ClusterInput()
print_temp = ClusterInput()
L = ClusterInput()
z_value = ClusterInput()
z_offset = ClusterInput()
brightness_values = ClusterInput()
y_value = ClusterInput()
low_speed = ClusterInput()
high_speed = ClusterInput()
x_value = ClusterInput()

# ---- group: Ironing
mm_min = Multiplication(LowSpeed=low_speed, B=60)
mm_min_2 = Multiplication(HighSpeed=high_speed, B=60)
ironing_speed_interval = ConstructDomain(DomainStart=mm_min, DomainEnd=mm_min_2)
remap = RemapNumbers(BrightnessValues=brightness_values, Source=Domain(0, 1), Target=ironing_speed_interval)  # -> Mapped, Clipped
adding_z_offset_for_ironing = Addition(ZValue=z_value, ZOffset=z_offset)
concat = Concatenate(
    FragmentH="G0 ",
    FragmentG="F",
    FragmentL=remap.Mapped,
    FragmentA=" X",
    FragmentB=x_value,
    FragmentC=" Y",
    FragmentD=y_value,
    FragmentE=" Z",
    FragmentF=adding_z_offset_for_ironing)

# ---- group: removing the highest speed ironing segments
txt = Text(concat)
S = Script(inputGCode=txt, cutoff=mm_min_2)  # -> out, A; inputs inputGCode: tree of String, cutoff: Double, zJump: Double
# ---------- S: C# ----------
using System;
using System.Collections.Generic;
using Grasshopper;
using Grasshopper.Kernel;
using Grasshopper.Kernel.Data;
using Grasshopper.Kernel.Types;
using Rhino.Geometry;

public class Script_Instance : GH_ScriptInstance
{
    private void RunScript(
	DataTree<string> inputGCode,
	double cutoff,
	double zJump,
	ref object A)
    {
        // Initialize a new DataTree for output
        DataTree<GH_String> outputLines = new DataTree<GH_String>();

        // Iterate through each branch of the input DataTree
        foreach (var path in inputGCode.Paths)
        {
            List<string> branchLines = inputGCode.Branch(path);
            List<GH_String> filteredLines = new List<GH_String>();
            bool previousLineAboveCutoff = false;
            GH_String lastLineAboveCutoff = null;

            // Iterate through the lines in the branch
            for (int i = 0; i < branchLines.Count; i++)
            {
                string currentLine = branchLines[i];
                double fValue = ExtractFValue(currentLine);

                if (fValue >= cutoff)
                {
                    // Mark this line to be potentially added later (as the last line above cutoff)
                    previousLineAboveCutoff = true;
                    lastLineAboveCutoff = new GH_String(currentLine); // Store the line for later modification
                }
                else
                {
                    // Add the last line above cutoff if it exists and this is the first occurrence below the cutoff
                    if (previousLineAboveCutoff && lastLineAboveCutoff != null)
                    {
                        // Check if the last line above cutoff is the first line in the list
                        if (filteredLines.Count == 0)
                        {
                            // Replace F value with 12000 for the last line above cutoff
                            string modifiedLine = ReplaceFValue(lastLineAboveCutoff.Value, 12000);
                            filteredLines.Add(new GH_String(modifiedLine));

                            // Add "G0 F2400 Z..." line after the last line above cutoff with its original Z value
                            double zValueLastCutoff = ExtractZValue(lastLineAboveCutoff.Value);
                            if (zValueLastCutoff != 0.0)
                            {
                                string newLineAfterCutoff = $"G0 F2400 Z{zValueLastCutoff}";
                                filteredLines.Add(new GH_String(newLineAfterCutoff));

                                // Now increase the Z value of the first line (lastLineAboveCutoff) by zJump
                                string lineWithZJump = ModifyZValue(modifiedLine, zValueLastCutoff + zJump);
                                filteredLines[0] = new GH_String(lineWithZJump); // Replace the first line with increased Z
                            }
                        }
                        else
                        {
                            // Just replace F value with 12000 for the last line above cutoff without adding new Z line
                            string modifiedLine = ReplaceFValue(lastLineAboveCutoff.Value, 12000);
                            filteredLines.Add(new GH_String(modifiedLine));
                        }

                        lastLineAboveCutoff = null; // Reset
                    }

                    filteredLines.Add(new GH_String(currentLine)); // Add the current line as is
                    previousLineAboveCutoff = false;
                }
            }

            // Add the last line above the cutoff if needed, but skip it if it's the last item in the list
            if (previousLineAboveCutoff && lastLineAboveCutoff != null)
            {
                // Check if the last line above cutoff is also the last line in the list
                if (branchLines.IndexOf(lastLineAboveCutoff.Value) != branchLines.Count - 1)
                {
                    string modifiedLine = ReplaceFValue(lastLineAboveCutoff.Value, 12000);
                    filteredLines.Add(new GH_String(modifiedLine));
                }
            }

            // Handle the first "G0" line modification after processing the cutoff
            for (int i = 0; i < filteredLines.Count; i++)
            {
                string line = filteredLines[i].Value;
                if (line.StartsWith("G0"))
                {
                    double fValueG0 = ExtractFValue(line);

                    // If F value is not 12000, modify the line
                    if (fValueG0 != 12000)
                    {
                        // Replace F value with 12000
                        string modifiedG0Line = ReplaceFValue(line, 12000);

                        // Extract original Z value from the first G0 line
                        double zValueG0Line = ExtractZValue(line);

                        if (zValueG0Line != 0.0)
                        {
                            // Insert the new line "G0 F2400 Z..." after the first G0 line, using the original Z value
                            string newLineAfterG0 = $"G0 F2400 Z{zValueG0Line}";
                            filteredLines.Insert(i + 1, new GH_String(newLineAfterG0));

                            // Increase the Z value of the first G0 line by zJump and update the line
                            string g0LineWithIncreasedZ = ModifyZValue(modifiedG0Line, zValueG0Line + zJump);
                            filteredLines[i] = new GH_String(g0LineWithIncreasedZ); // Update the first G0 line
                        }
                    }
                    break; // Exit loop after modifying the first G0 line
                }
            }

            // Handle the last line by increasing its Z value by zJump and adding a new line
            if (filteredLines.Count > 0)
            {
                // Extract the Z value from the last line
                string lastLine = filteredLines[filteredLines.Count - 1].Value;
                double zValueLast = ExtractZValue(lastLine);

                // Add a new line "G0 F2400 Z..." at the end with Z increased by zJump
                if (zValueLast != 0.0) // Only add if a valid Z value is found
                {
                    string newEndLine = $"G0 F2400 Z{zValueLast + zJump}";
                    filteredLines.Add(new GH_String(newEndLine)); // Append the new line at the end of the output list
                }
            }

            // Add the filtered branch to the output DataTree
            outputLines.AddRange(filteredLines, path);
        }

        A = outputLines;
    }

    // Helper method to extract the F value from a line
    private double ExtractFValue(string line)
    {
        string[] parts = line.Split(' ');
        foreach (var part in parts)
        {
            if (part.StartsWith("F"))
            {
                if (double.TryParse(part.Substring(1), out double fValue))
                {
                    return fValue;
                }
            }
        }
        return 0.0; // Default value if no F value is found, assuming double
    }

    // Helper method to extract the Z value from a line
    private double ExtractZValue(string line)
    {
        string[] parts = line.Split(' ');
        foreach (var part in parts)
        {
            if (part.StartsWith("Z"))
            {
                if (double.TryParse(part.Substring(1), out double zValue))
                {
                    return zValue;
                }
            }
        }
        return 0.0; // Default value if no Z value is found
    }

    // Helper method to replace the F value in a line
    private string ReplaceFValue(string line, double newFValue)
    {
        string[] parts = line.Split(' ');
        for (int i = 0; i < parts.Length; i++)
        {
            if (parts[i].StartsWith("F"))
            {
                parts[i] = "F" + newFValue.ToString(); // Replace with the new F value
            }
        }
        return string.Join(" ", parts); // Rebuild the line
    }

    // Helper method to modify the Z value in a line
    private string ModifyZValue(string line, double newZValue)
    {
        string[] parts = line.Split(' ');
        for (int i = 0; i < parts.Length; i++)
        {
            if (parts[i].StartsWith("Z"))
            {
                parts[i] = "Z" + newZValue.ToString(); // Replace with the new Z value
            }
        }
        return string.Join(" ", parts); // Rebuild the line
    }
}
# ---------- end S ----------

# ---- group: Preheating printing nozzle
replace_the_highest_speed_with_0 = ReplaceText(Text=remap.Mapped, HighSpeed=mm_min_2, Replace="0", RecursiveReplace=False)
concat_2 = Concatenate(FragmentA="M104 T0 S", FragmentB=print_temp)
repeat = RepeatData(Data=concat_2, Length=L)  # -> simplify(Data)
getheatupline = Script(speeds_tree=replace_the_highest_speed_with_0, segment_length=segment_length, heating_time=heating_time)  # -> out, result; inputs speeds_tree: tree of Double, segment_length: Double, heating_time: Double
# ---------- getheatupline: Python ----------
import Rhino.Geometry as rg
import Grasshopper as gh

def process_data_tree(speeds_tree, segment_length, heating_time):
    critical_indices_tree = gh.DataTree[int]()

    for branch_index in range(speeds_tree.BranchCount):
        branch_path = speeds_tree.Path(branch_index)
        branch = speeds_tree.Branch(branch_path)
        total_time = sum(segment_length / speed for speed in branch if speed > 0)

        for i, speed in enumerate(branch):
            if speed > 0:  # Avoid division by zero
                segment_time = segment_length / speed
                total_time -= segment_time
                if total_time < heating_time:
                    critical_indices_tree.Add(i, branch_path)
                    break
        else:
            # In case no segment in the branch meets the criterion
            critical_indices_tree.Add(None, branch_path)

    return critical_indices_tree

# Example usage in Grasshopper
# speeds_tree = ...  # This is your DataTree input
# segment_length = ...  # Your segment length input
# heating_time = ...  # Your heating time input
result = process_data_tree(speeds_tree, segment_length, heating_time)
# ---------- end getheatupline ----------
graft = GraftTree(Tree=repeat, IncludeEmptyLists=True, IncludeNullItems=True)  # -> graft(Tree)
match_tree = MatchTree(Tree=graft, Guide=getheatupline.result)
ins = InsertItems(List=S.A, Item=match_tree, Indices=getheatupline.result, Wrap=True)

# ----
L_2 = ClusterOutput(ins)

# ==== cluster SwitchToIroningNozzle
retraction_speed = ClusterInput()
wait_temp = ClusterInput()
retraction_length = ClusterInput()
e_value = ClusterInput()
points_with_x_offset = ClusterInput()
acceleration = ClusterInput()
L = ClusterInput()

# ---- group: Switch to Ironing Nozzle
subtraction = Subtraction(EValue=e_value, RetractionLength=retraction_length)
concat = Concatenate(FragmentD="G1 ", FragmentC="F", RetractionSpeed=retraction_speed, FragmentA=" E", FragmentB=subtraction)

# ----
jerk = ClusterInput()
z_value = ClusterInput()
z_offset = ClusterInput()
z_jump = ClusterInput()

# ---- group: Switch to Ironing Nozzle / travel to the first point
item = ListItem(PointsWithXOffset=points_with_x_offset, Index=Slider(0, range=0..100), Wrap=True)
pdecon = Deconstruct(Point=item)  # -> XComponent, YComponent, ZComponent
F = Slider(15000, range=0..100000)
addition = Addition(A=pdecon.ZComponent, ZOffset=z_offset)
concat_2 = Concatenate(
    FragmentH="G0 ",
    FragmentG="F",
    FragmentL=F,
    FragmentA=" X",
    FragmentB=pdecon.XComponent,
    FragmentC=" Y",
    FragmentD=pdecon.YComponent,
    FragmentE=" Z",
    FragmentF=addition)

# ----
panel = Panel(L)
old_one = Panel("""G0 F15000 X213 Y189
T1""")

# ---- group: Switch to Ironing Nozzle / Z jump
list_item = ListItem(ZValue=z_value, Index=0, Wrap=True)
repeat = RepeatData(Data="G0 F1800 Z", Length=L)  # -> graft(Data)
addition_2 = Addition(ZValues=list_item, ZJump=z_jump)
match_tree = MatchTree(Tree=repeat, Guide=concat)
concat_3 = Concatenate(FragmentA=match_tree, FragmentB=addition_2)

# ----
concat_4 = Concatenate(FragmentA="M204 S", Acceleration=acceleration)
concat_5 = Concatenate(FragmentA="M205 ", FragmentB="X", FragmentC=jerk, FragmentD=" Y", FragmentB_2=jerk)

# ---- group: Switch to Ironing Nozzle
concat_6 = Concatenate(FragmentA="M104 T0 S", FragmentB=wait_temp)
repeat_2 = RepeatData(Data=concat_6, Length=L)  # -> simplify(graft(Data))

panel_2 = Panel("""G0 F12000
T1""")
repeat_3 = RepeatData(Data=panel_2, Length=L)  # -> simplify(graft(Data))

# ----
repeat_4 = RepeatData(Data=concat_5, Length=L)  # -> simplify(graft(Data))
repeat_5 = RepeatData(Data=concat_4, Length=L)  # -> simplify(graft(Data))

# ---- group: Switch to Ironing Nozzle
repeat_6 = RepeatData(Data="M107", Length=L)  # -> graft(Data)

# ----
match_tree_2 = MatchTree(Tree=repeat_4, Guide=concat)
match_tree_3 = MatchTree(Tree=repeat_5, Guide=concat)
match_tree_4 = MatchTree(Tree=repeat_6, Guide=concat)
match_tree_5 = MatchTree(Tree=repeat_2, Guide=concat)
match_tree_6 = MatchTree(Tree=repeat_3, Guide=concat)

# ---- group: Switch to Ironing Nozzle
merge = Merge(
    Data1=simplify(match_tree_5),
    Data2=simplify(concat),
    Data3=simplify(concat_3),
    Data4=simplify(match_tree_4),
    Data5=simplify(match_tree_6),
    Data7=simplify(match_tree_3),
    Data8=simplify(match_tree_2))

# ----
R = ClusterOutput(merge)
panel_3 = Panel(merge)

# ==== cluster SwitchToPrinting
nonmesh_layers = ClusterInput()
z_jump_gcode = ClusterInput()
e_value = ClusterInput()
cull_pattern = ClusterInput()
L = ClusterInput()

# ---- group: Switch to Printing Nozzle
item = ListItem(List=nonmesh_layers, Index=1, Wrap=True)
F = Text("F")
split = TextSplit(Text=item, Separators=" ")
concat = Concatenate(FragmentA=F, FragmentB=Slider(15000, range=0..100000))
replace = ReplaceItems(List=simplify(split), Item=concat, Indices=1, Wrap=False)  # -> simplify(List)
cull_i = CullIndex(List=replace, Indices=4, Wrap=True)
old_one = Panel("""G0 F15000 X213 Y189
T0""")
join = TextJoin(Text=cull_i, Join=" ")
panel = Panel("""G0 F12000
T0""")
cluster = Cluster(tree=join, cull_pattern=cull_pattern)
repeat = RepeatData(Data=panel, Length=L)
concat_2 = Concatenate(FragmentD="G1 ", FragmentC="F", FragmentE=Slider(1500, range=0..10000), FragmentA=" E", FragmentB=e_value)
graft = GraftTree(Tree=repeat, IncludeEmptyLists=True, IncludeNullItems=True)  # -> graft(Tree)
repeat_2 = RepeatData(Data="M106 S255", Length=L)  # -> graft(Data)
match_tree = MatchTree(Tree=graft, Guide=concat_2)
match_tree_2 = MatchTree(Tree=repeat_2, Guide=concat_2)
merge = Merge(
    Data1=simplify(z_jump_gcode),
    Data2=simplify(match_tree),
    Data3=simplify(cluster),
    Data4=simplify(nonmesh_layers),
    Data5=simplify(concat_2),
    Data6=simplify(match_tree_2))

# ----
switchtoprinting_gcode = ClusterOutput(merge)

# ==== cluster Retraction
tree = ClusterInput()
cull_pattern = ClusterInput()

e_values = Script(tree=tree)  # -> out, final_e_values; inputs tree: tree
# ---------- e_values: Python ----------
import ghpythonlib.treehelpers as th

def extract_final_e_value_per_branch(tree):
    """
    Extracts the final E value for each branch of the input Grasshopper tree.

    :param tree: A Grasshopper DataTree where each item in a branch is a line of G-code.
    :return: A Grasshopper DataTree where each branch contains the final E value.
    """
    final_e_values = []

    for branch in tree.Branches:
        last_e_value = None
        for item in branch:
            if 'E' in item:
                parts = item.split('E')
                try:
                    last_e_value = float(parts[-1])
                except ValueError:
                    pass
        if last_e_value is not None:
            final_e_values.append([last_e_value])

    return th.list_to_tree(final_e_values)


# This function should be connected to a Grasshopper component
# The input 'tree' should be connected to the G-code data tree
# The output will be a tree where each branch contains the final E value of the corresponding input branch

final_e_values = extract_final_e_value_per_branch(tree)
# ---------- end e_values ----------
num = Number(e_values.final_e_values)
cluster = Cluster(tree=num, cull_pattern=cull_pattern)

e_value = ClusterOutput(cluster)

# ==== cluster Cluster_2
material = ClusterInput()
method = ClusterInput()
_3mfpath = ClusterInput()
objpath = ClusterInput()
imagepath = ClusterInput()
gcodepath = ClusterInput()
points = ClusterInput()
texture_methods = TextureMethods(method=method, _3mfpath=_3mfpath, objpath=objpath, projectedimagepath=imagepath, filepath=gcodepath, points=points)  # -> obj, projection
color_mapping = ColorMapping(method=method, obj=texture_methods.obj, projection=texture_methods.projection, material=material)
color_mapping_2 = ClusterOutput(color_mapping)

# ==== cluster SaveGcodeFile
combined_gcode = ClusterInput()
generate_gcode = ClusterInput()
material = ClusterInput()
stream_gate = StreamGate(CombinedGcode=combined_gcode, GenerateGcode=generate_gcode)  # -> Target0, Target1
stream_filter = StreamFilter(Material=material, Stream0="LW-PLA", Stream1="Corkfill", Stream2="Woodfill")
printer_name = ClusterInput()
gcode_name = ClusterInput()
concatenate = Concatenate(Printer_name=printer_name, A="_", material=stream_filter, B="_", Gcode_name=gcode_name, D=".gcode")
directorypath = ClusterInput()
writegcode = CSharpScript(texts=stream_gate.Target1, directoryPath=directorypath, fileName=concatenate)  # -> out, A; inputs texts: list of String, directoryPath: String, fileName: String
# ---------- writegcode: C# ----------
// Grasshopper Script Instance
using System;
using System.Collections;
using System.Collections.Generic;
using System.Drawing;

using Rhino;
using Rhino.Geometry;

using Grasshopper;
using Grasshopper.Kernel;
using Grasshopper.Kernel.Data;
using Grasshopper.Kernel.Types;

public class Script_Instance : GH_ScriptInstance
{
private void RunScript(
	IList<string> texts,
	string directoryPath,
	string fileName,
	ref object A)
{
    // Concatenate all list items into one big text block
    string combinedText = string.Join("\n", texts);

    // Ensure the directory exists
    if(!System.IO.Directory.Exists(directoryPath))
    {
        System.IO.Directory.CreateDirectory(directoryPath);
    }

    // Ensure the output subdirectory exists
    string outputDirectoryPath = System.IO.Path.Combine(directoryPath, "output");
    if(!System.IO.Directory.Exists(outputDirectoryPath))
    {
        System.IO.Directory.CreateDirectory(outputDirectoryPath);
    }

    // Combine the directory path and the "output" subfolder with the file name to create the full file path
    string filePath = System.IO.Path.Combine(outputDirectoryPath, fileName);

    // Check if the file exists and append a numeric suffix if it does
    string fileBaseName = System.IO.Path.GetFileNameWithoutExtension(fileName);
    string fileExtension = System.IO.Path.GetExtension(fileName);
    int counter = 1;
    while(System.IO.File.Exists(filePath))
    {
        string newFileName = $"{fileBaseName}-{counter}{fileExtension}";
        filePath = System.IO.Path.Combine(outputDirectoryPath, newFileName);
        counter++;
    }

    // Write the combined text to the file
    try
    {
        System.IO.File.WriteAllText(filePath, combinedText);
        A = "Text written successfully to " + filePath;
    }
    catch(System.Exception ex)
    {
        A = "Error writing file: " + ex.Message;
    }
}


}
# ---------- end writegcode ----------
A = ClusterOutput(writegcode.A)

# ==== cluster IroningSettings
panel = Panel("""Custom
TempPrintNozzle=
TempIroningNozzle=
BedTemperature=
WaitTempPrintNozzle=
SamplingLength=
LowSpeed=
HighSpeed=
XOffset=
ZOffset=
RetractionLength=
RetractionSpeed=
HeatingTime=""")
advanced_settings = ClusterInput()
panel_2 = Panel("""LW-PLA (printer2)
TempPrintNozzle=200
TempIroningNozzle=300
BedTemperature=60
WaitTempPrintNozzle=175
SamplingLength=0.2
LowSpeed=1
HighSpeed=60
XOffset=-18
ZOffset=0
RetractionLength=15
RetractionSpeed=1500
HeatingTime=5""")
panel_3 = Panel("""Corkfill
TempPrintNozzle=205
TempIroningNozzle=330
BedTemperature=60
WaitTempPrintNozzle=175
SamplingLength=0.2
LowSpeed=1.5
HighSpeed=20
XOffset=-22
ZOffset=0
RetractionLength=15
RetractionSpeed=1500
HeatingTime=5""")
panel_4 = Panel("""Woodfill
TempPrintNozzle=205
TempIroningNozzle=325
BedTemperature=60
WaitTempPrintNozzle=175
SamplingLength=0.2
LowSpeed=1
HighSpeed=10
XOffset=-18
ZOffset=0
RetractionLength=15
RetractionSpeed=1500
HeatingTime=5""")
concatenate = Concatenate(Fragment_A=panel, Advanced_settings=advanced_settings)
material = ClusterInput()
filter = StreamFilter(Material=material, Stream0=panel_2, Stream1=panel_3, Stream2=panel_4)
text_join = TextJoin(Text=concatenate)  # -> flatten(Result)
advanced_settings_toggle = ClusterInput()
stream_filter = StreamFilter(AdvancedSettingsToggle=advanced_settings_toggle, Stream0=filter, Stream1=text_join)
S = Script(x=stream_filter)  # -> out, TempPrintNozzle, TempIroningNozzle, BedTemperature, WaitTempPrintNozzle, SamplingLength, LowSpeed, HighSpeed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; inputs x: String
# ---------- S: Python ----------
# Function to process the material settings text
def process_material_settings(text):
    # Splitting the text into lines
    lines = text.split('\n')
    # Extracting key-value pairs
    params = {line.split('=')[0]: float(line.split('=')[1]) for line in lines if '=' in line}
    return params

# Replace 'x' with the actual input variable connected to your text panel
material_settings = x
params = process_material_settings(material_settings)

# Assigning values to outputs
# Ensure you have the right number of outputs on your Python component
TempPrintNozzle = params.get("TempPrintNozzle", 0)
TempIroningNozzle = params.get("TempIroningNozzle", 0)
BedTemperature = params.get("BedTemperature", 0)
WaitTempPrintNozzle = params.get("WaitTempPrintNozzle", 0)
SamplingLength = params.get("SamplingLength", 0)
LowSpeed = params.get("LowSpeed", 0)
HighSpeed = params.get("HighSpeed", 0)
XOffset = params.get("XOffset", 0)
ZOffset = params.get("ZOffset", 0)
RetractionLength = params.get("RetractionLength", 0)
RetractionSpeed = params.get("RetractionSpeed", 0)
HeatingTime = params.get("HeatingTime", 0)
# ---------- end S ----------
ironing_speed_high = Number(S.HighSpeed)
print_temperature = Number(S.TempPrintNozzle)
ironing_speed_low = Number(S.LowSpeed)
zoffset = Number(S.ZOffset)
ironing_temperature = Number(S.TempIroningNozzle)
bed_temperature = Number(S.BedTemperature)
print_nozzle_wait_temperature = Number(S.WaitTempPrintNozzle)
print_nozzle_preheating_time = Number(S.HeatingTime)
retractionspeed = Number(S.RetractionSpeed)
sampling_length = Number(S.SamplingLength)
retractionlength = Number(S.RetractionLength)
ironing_speed_high_2 = ClusterOutput(ironing_speed_high)
print_temperature_2 = ClusterOutput(print_temperature)
ironing_speed_low_2 = ClusterOutput(ironing_speed_low)
zoffset_2 = ClusterOutput(zoffset)
ironing_temperature_2 = ClusterOutput(ironing_temperature)
bed_temperature_2 = ClusterOutput(bed_temperature)
print_nozzle_wait_temperature_2 = ClusterOutput(print_nozzle_wait_temperature)
print_nozzle_preheating_time_2 = ClusterOutput(print_nozzle_preheating_time)
retractionspeed_2 = ClusterOutput(retractionspeed)
sampling_length_2 = ClusterOutput(sampling_length)
retractionlength_2 = ClusterOutput(retractionlength)

# ==== cluster Cluster_3
directory = ClusterInput()
readdirectory = Python3Script(directory=directory)  # -> out, gcode, threemf, obj, texture, warning
# ---------- readdirectory: Python ----------
import os

def find_files(directory, extensions):
    found_files = []
    for root, dirs, files in os.walk(directory):
        for file in files:
            if any(file.lower().endswith(ext) for ext in extensions):
                found_files.append(os.path.join(root, file))
        break  # Search only the specified directory
    return found_files

def main(directory):
    # Extend the file_types dictionary to include gcode
    file_types = {
        '3mf': ['.3mf'],
        'obj': ['.obj'],
        'image': ['.jpg', '.jpeg', '.png', '.bmp', '.gif'],
        'gcode': ['.gcode']
    }

    # Initialize outputs
    output_3mf = None
    output_obj = None
    output_img = None
    output_gcode = None  # Added for gcode files
    output_warnings = []

    # Search for files and handle multiple files of the same type
    for key, extensions in file_types.items():
        files = find_files(directory, extensions)
        if len(files) > 1:
            output_warnings.append(f"More than one {key} file found.")
        if files:
            if key == '3mf':
                output_3mf = files[0]
            elif key == 'obj':
                output_obj = files[0]
            elif key == 'image':
                output_img = files[0]
            elif key == 'gcode':  # Assign the first gcode file if exists
                output_gcode = files[0]

    return output_3mf, output_obj, output_img, output_gcode, output_warnings

# Replace 'your_directory_path_here' with the actual path

threemf, obj, texture, gcode, warning = main(directory)
# ---------- end readdirectory ----------
threemf = ClusterOutput(readdirectory.threemf)
obj = ClusterOutput(readdirectory.obj)
texture = ClusterOutput(readdirectory.texture)
gcodepath = FilePath(readdirectory.gcode)
gcodepath_2 = ClusterOutput(gcodepath)
extruder0name = ClusterInput()
extruder1name = ClusterInput()
temp0 = ClusterInput()
temp1 = ClusterInput()
tempbed = ClusterInput()

gcodedata = GcodeData(filepath=gcodepath)  # -> zperlayer, header, regular_layers, nonmesh_layers, footer, first_xy_lines
prepareheader = Script(
    input_header=gcodedata.header,
    temp0=temp0,
    temp1=temp1,
    tempBed=tempbed,
    extruder0Name=extruder0name,
    extruder1Name=extruder1name)  # -> out, output_header; inputs input_header: String, temp0: Int32, temp1: Int32, tempBed: Int32, extruder0Name: String, extruder1Name: String
# ---------- prepareheader: Python ----------
def replace_temperatures_and_add_extruder(input_header, temp0, tempBed, temp1, extruder0Name, extruder1Name):
    # Split the text into lines
    lines = input_header.split('\n')

    # Variables to store the index and material GUID of Extruder 0
    extruder0_end_index = -1
    material_guid_extruder0 = ""

    # Iterate through each line
    for i in range(len(lines)):
        # Check if the line contains the target string for extruder 0 temperature
        if lines[i].startswith(';EXTRUDER_TRAIN.0.INITIAL_TEMPERATURE:'):
            lines[i] = ';EXTRUDER_TRAIN.0.INITIAL_TEMPERATURE:' + str(temp0)
        
        # Check if the line contains the target string for bed temperature
        elif lines[i].startswith(';BUILD_PLATE.INITIAL_TEMPERATURE:'):
            lines[i] = ';BUILD_PLATE.INITIAL_TEMPERATURE:' + str(tempBed)

        # Store the material GUID of Extruder 0
        elif lines[i].startswith(';EXTRUDER_TRAIN.0.MATERIAL.GUID:'):
            material_guid_extruder0 = lines[i].split(':')[1]

        # Update the nozzle name for Extruder 0
        if lines[i].startswith(';EXTRUDER_TRAIN.0.NOZZLE.NAME:'):
            lines[i] = ';EXTRUDER_TRAIN.0.NOZZLE.NAME:' + extruder0Name
            extruder0_end_index = i

    # Insert the new lines for EXTRUDER_TRAIN.1 after EXTRUDER_TRAIN.0 block, including the dynamic extruder train 1 name
    if extruder0_end_index != -1:
        extruder1_lines = [
            ';EXTRUDER_TRAIN.1.INITIAL_TEMPERATURE:' + str(temp1),
            ';EXTRUDER_TRAIN.1.MATERIAL.VOLUME_USED:0',
            # ';EXTRUDER_TRAIN.1.MATERIAL.GUID:' + material_guid_extruder0, # Uncomment if you want to copy the GUID from Extruder 0
            ';EXTRUDER_TRAIN.1.MATERIAL.GUID:506c9f0d-e3aa-4bd4-b2d2-23e2425b1aa9',
            ';EXTRUDER_TRAIN.1.NOZZLE.DIAMETER:0.4',
            ';EXTRUDER_TRAIN.1.NOZZLE.NAME:' + extruder1Name
        ]
        lines[extruder0_end_index + 1:extruder0_end_index + 1] = extruder1_lines

    # Join the lines back into a single text
    output_header = '\n'.join(lines)
    return output_header


output_header = replace_temperatures_and_add_extruder(input_header, temp0, tempBed, temp1, extruder0Name, extruder1Name)

print(output_header)
# ---------- end prepareheader ----------
remove_m104_m109 = Script(gcode=gcodedata.regular_layers)  # -> out, newGcode; inputs gcode: String
# ---------- remove_m104_m109: C# ----------
// Grasshopper Script Instance
using System;
using System.Collections;
using System.Collections.Generic;
using System.Drawing;

using Rhino;
using Rhino.Geometry;

using Grasshopper;
using Grasshopper.Kernel;
using Grasshopper.Kernel.Data;
using Grasshopper.Kernel.Types;

public class Script_Instance : GH_ScriptInstance
{
  /* 
    Members:
      RhinoDoc RhinoDocument
      GH_Document GrasshopperDocument
      IGH_Component Component
      int Iteration

    Methods (Virtual & overridable):
      Print(string text)
      Print(string format, params object[] args)
      Reflect(object obj)
      Reflect(object obj, string method_name)
  */
  
  private void RunScript(string gcode, ref object newGcode)
{
    var lines = gcode.Split(new[] { "\r\n", "\r", "\n" }, StringSplitOptions.None);
    var output = new System.Text.StringBuilder();

    foreach (var line in lines)
    {
        if (!line.Contains("M104") && !line.Contains("M109"))
        {
            output.AppendLine(line);
        }
    }

    newGcode = output.ToString();
}

}
# ---------- end remove_m104_m109 ----------

header = ClusterOutput(gcodedata.header)
nonmesh_layers = ClusterOutput(gcodedata.nonmesh_layers)
footer = ClusterOutput(gcodedata.footer)
sampling_length = ClusterInput()
newgcode = ClusterOutput(remove_m104_m109.newGcode)
output_header = ClusterOutput(prepareheader.output_header)
ironing_points = IroningPoints(gcode_tree=remove_m104_m109.newGcode, sampling_length=sampling_length)
points = ClusterOutput(ironing_points)

# ==== cluster Cluster_4
color_mapping = ClusterInput()
generate_gcode = ClusterInput()
stream_gate = StreamGate(ColorMapping=color_mapping, GenerateGcode=generate_gcode)  # -> Target0, Target1

# ---- group: remove no-ironing layers
mass_addition = MassAddition(Input=stream_gate.Target1)  # -> Result, PartialResults
tree_statistics = TreeStatistics(Tree=stream_gate.Target1)  # -> Paths, Length, Count
equality = Equality(FirstNumber=tree_statistics.Length, SecondNumber=flatten(mass_addition.Result))  # -> Equality, Inequality
cull_pattern = CullPattern(List=tree_statistics.Paths, CullPattern=equality.Inequality)
tree_branch = TreeBranch(Tree=stream_gate.Target1, Path=cull_pattern, MaintainPaths=True)
tree_statistics_2 = TreeStatistics(Tree=tree_branch)  # -> Paths, Length, Count

# ----
cull_pattern_2 = ClusterOutput(equality.Inequality)
branch = ClusterOutput(tree_branch)
count = ClusterOutput(tree_statistics_2.Count)

# ==== cluster RemoveNoIroningLayers
generate_gcode = ClusterInput()
cull_pattern = ClusterInput()
points = ClusterInput()
input_list = ClusterInput()
stream_gate = StreamGate(Stream=points, GenerateGcode=generate_gcode)  # -> Target0, Target1

# ---- group: remove no-ironing layers
tree_statistics = TreeStatistics(Points=stream_gate.Target1)  # -> Paths, Length, Count
cull_pattern_2 = CullPattern(List=tree_statistics.Paths, CullPattern=cull_pattern)
tree_branch = TreeBranch(Tree=stream_gate.Target1, Path=cull_pattern_2, MaintainPaths=True)
tree_statistics_2 = TreeStatistics(Tree=tree_branch)  # -> Paths, Length, Count

# ---- group: x offset
getultimakertype = Python3Script(input_list=flatten(input_list))  # -> out, machine_code, machine_abbreviation; inputs input_list: list of String
# ---------- getultimakertype: Python ----------
def get_machine_code_and_name(input_list):
    # Dictionary to map machine names to their codes
    machine_codes = {
        'Ultimaker 3': 0,
        'Ultimaker S3': 1,
        'Ultimaker S5': 2,
        'Ultimaker S7': 3,
    }
    
    # Dictionary to map machine names to their abbreviated names
    machine_names = {
        'Ultimaker 3': 'UM3',
        'Ultimaker S3': 'UMS3',
        'Ultimaker S5': 'UMS5',
        'Ultimaker S7': 'UMS7',
    }

    # Iterate through each item in the list
    for item in input_list:
        if item.startswith(';TARGET_MACHINE.NAME:'):
            # Extract the machine name from the item
            machine_name = item.split(':')[1].strip()
            # Get the machine code and abbreviated name
            machine_code = machine_codes.get(machine_name, -1)  # Returns -1 if the machine name is not found
            machine_abbreviation = machine_names.get(machine_name, "Unknown")  # Returns "Unknown" if the machine name is not found
            # Return both code and abbreviation
            return machine_code, machine_abbreviation

    return -1, "Unknown"  # Returns -1 and "Unknown" if the target machine name line is not found

# Example usage
machine_code, machine_abbreviation = get_machine_code_and_name(input_list)
print(f"Machine Code: {machine_code}, Machine Name: {machine_abbreviation}")
# ---------- end getultimakertype ----------
filter = StreamFilter(Gate=getultimakertype.machine_code, Stream0="-18", Stream1="-22", Stream2="-22", Stream3="-22")
num = Number(filter)
X = UnitX(Factor=num)
move = Move(Geometry=tree_branch, Motion=X)  # -> PointsWithXOffset, Transform

# ----
machine_abbreviation = ClusterOutput(getultimakertype.machine_abbreviation)
points_with_x_offset = ClusterOutput(move.PointsWithXOffset)
pdecon = Deconstruct(Point=move.PointsWithXOffset)  # -> XComponent, YComponent, ZComponent
count = ClusterOutput(tree_statistics_2.Count)
X_2 = ClusterOutput(pdecon.XComponent)
Y = ClusterOutput(pdecon.YComponent)
Z = ClusterOutput(pdecon.ZComponent)

# ==== cluster Cluster
tree = ClusterInput()
tree_statistics = TreeStatistics(Tree=tree)  # -> Paths, Length, Count
cull_pattern = ClusterInput()
cull_pattern_2 = CullPattern(List=tree_statistics.Paths, CullPattern=cull_pattern)
tree_branch = TreeBranch(Tree=tree, Path=cull_pattern_2, MaintainPaths=True)
branch = ClusterOutput(tree_branch)

# ==== cluster ColorMapping
projection = ClusterInput()
method = ClusterInput()
obj = ClusterInput()
material = ClusterInput()

# ---- group: Color mapping
filter = StreamFilter(Method=method, Stream0=projection, Stream1=obj)
stream_gate = StreamGate(Stream=filter, Material=material)  # -> Target0, Target1, Target2
subtraction = Subtraction(A=Slider(1, range=0..1), B=stream_gate.Target0)  # -> simplify(Result)
stream_gate_2 = StreamGate(Stream=subtraction, Gate=material)  # -> Target0, Target1, Target2
lw_pla = GraphMapper(stream_gate_2.Target0, x0=0, x1=1, y0=0, y1=1, Cx=0.7048870325, Cy=0.3010368943, container_name="Conic")
corkfill = GraphMapper(stream_gate.Target1, x0=0, x1=1, y0=0, y1=1, Cx=0.9047268033, Cy=0.4432656169, container_name="Conic")
woodfill = GraphMapper(stream_gate.Target2, x0=0, x1=1, y0=0, y1=1, Cx=0.9047268033, Cy=0.4432656169, container_name="Conic")
combine = CombineData(Input0=lw_pla, Input1=corkfill, Input2=woodfill)  # -> ColorMapping, Index

# ----
color_mapping = ClusterOutput(combine.ColorMapping)

# ==== cluster TextureMethods
projectedimagepath = ClusterInput()
filepath = ClusterInput()
method = ClusterInput()
parse_gcode = Script(filePath=filepath)  # -> out, layers, layerHeight, min_x, min_y, min_z, max_x, max_y, max_z
# ---------- parse_gcode: Python ----------
import Rhino
import scriptcontext as sc
import rhinoscriptsyntax as rs

def extract_layer_count(file_path):
    layer_count = None
    try:
        with open(file_path, 'r') as file:
            for line in file:
                if line.startswith(';LAYER_COUNT'):
                    _, count_str = line.split(':')
                    layer_count = int(count_str.strip())
                    break
    except Exception as e:
        print(f"Error reading file: {e}")
    return layer_count

def calculate_average_z_difference(file_path):
    z_values = []
    record_z = False
    try:
        with open(file_path, 'r') as file:
            for line in file:
                if ';TYPE:SKIRT' in line:
                    record_z = True
                elif 'G91 ;Relative movement' in line:
                    break  # Stop recording when this line is encountered

                if record_z and line.startswith(('G0', 'G1')) and ' Z' in line:
                    parts = line.split(' ')
                    for part in parts:
                        if part.startswith('Z'):
                            z_value = float(part[1:])
                            z_values.append(z_value)
                            break
    except Exception as e:
        print(f"Error reading file: {e}")
        return None

    if len(z_values) < 2:
        print("Not enough Z values found between ;TYPE:SKIRT and G91 ;Relative movement.")
        return None

    # Calculate differences between consecutive Z values
    differences = [abs(z_values[i] - z_values[i-1]) for i in range(1, len(z_values))]
    # Calculate average difference
    average_difference = sum(differences) / len(differences)
    return average_difference


def find_min_max_values(file_path):
    min_x, min_y, min_z = float('inf'), float('inf'), float('inf')
    max_x, max_y, max_z = float('-inf'), float('-inf'), float('-inf')
    start_processing = False  # Flag to indicate when to start processing

    try:
        with open(file_path, 'r') as file:
            for line in file:
                if line.startswith(';MESH'):
                    start_processing = True
                    continue  # Skip the ';MESH' line
                elif 'G91' in line:
                    break  # Stop recording when this line is encountered

                if start_processing and line.startswith('G'):
                    parts = line.split(' ')
                    for part in parts:
                        if part.startswith('X'):
                            x_value = float(part[1:])
                            min_x = min(min_x, x_value)
                            max_x = max(max_x, x_value)
                        elif part.startswith('Y'):
                            y_value = float(part[1:])
                            min_y = min(min_y, y_value)
                            max_y = max(max_y, y_value)
                        elif part.startswith('Z'):
                            z_value = float(part[1:])
                            min_z = min(min_z, z_value)
                            max_z = max(max_z, z_value)

    except Exception as e:
        print(f"Error reading file: {e}")
        return None, None, None, None, None, None

    # Check if any min/max values were updated from their initial values
    if min_x == float('inf') or max_x == float('-inf'):
        return None, None, None, None, None, None

    return min_x, max_x, min_y, max_y, min_z, max_z



# Assume 'file_path' is the input to the Grasshopper component
layers = extract_layer_count(filePath)

layerHeight = calculate_average_z_difference(filePath)

# Assume 'file_path' is the input to the Grasshopper component
min_x, max_x, min_y, max_y, min_z, max_z = find_min_max_values(filePath)
# ---------- end parse_gcode ----------
points = ClusterInput()
_3mfpath = ClusterInput()
objpath = ClusterInput()
image_projection = ImageProjection(
    method=method,
    projectedimagepath=projectedimagepath,
    points=points,
    minx=parse_gcode.min_x,
    maxx=parse_gcode.max_x,
    minz=parse_gcode.min_z,
    maxz=parse_gcode.max_z)
obj_texture = OBJTexture(
    method=method,
    _3mfpath=_3mfpath,
    objpath=objpath,
    texturepath=projectedimagepath,
    inputpointsinput=points,
    minx=parse_gcode.min_x,
    miny=parse_gcode.min_y,
    minz=parse_gcode.min_z,
    maxx=parse_gcode.max_x,
    maxy=parse_gcode.max_y,
    maxz=parse_gcode.max_z)
obj = ClusterOutput(obj_texture)
projection = ClusterOutput(image_projection)

# ==== cluster GcodeData
filepath = ClusterInput()
separate_gcode = Script(filePath=filepath)  # -> out, header, regular_layers, nonmesh_layers, footer, first_xy_lines
# ---------- separate_gcode: Python ----------
import ghpythonlib.treehelpers as th

def split_gcode_into_header_layers_footer(file_path):
    regular_layers = []  # Store regular layer lines
    nonmesh_layers = []  # Store nonmesh layer lines
    current_layer = []  # Store lines for the current layer
    current_nonmesh = [] # Store lines for the current nonmesh part
    first_xy_lines = []  # Store the first XY line of each regular layer
    found_first_xy_line = False  # Flag for the first XY line in a layer
    in_nonmesh = False   # Flag to indicate if currently processing nonmesh part

    header = []
    footer = []
    processing_header = True
    processing_footer = False

    try:
        with open(file_path, 'r') as file:
            for line in file:
                if processing_header:
                    if ";LAYER:0" in line:
                        processing_header = False
                    else:
                        header.append(line.strip())
                        continue

                if "M204 S3000" in line:
                    processing_footer = True

                if processing_footer:
                    footer.append(line.strip())
                    continue

                if line.startswith(';LAYER'):
                    if current_layer:
                        regular_layers.append(current_layer)
                        nonmesh_layers.append(current_nonmesh if current_nonmesh else [])
                        current_nonmesh = []
                    current_layer = [line.strip()]
                    in_nonmesh = False
                    found_first_xy_line = False
                elif ';MESH:NONMESH' in line:
                    in_nonmesh = True
                    if current_nonmesh:
                        nonmesh_layers.append(current_nonmesh)
                    current_nonmesh = [line.strip()]
                else:
                    if in_nonmesh:
                        current_nonmesh.append(line.strip())
                    else:
                        current_layer.append(line.strip())
                        if not found_first_xy_line and ("X" in line and "Y" in line) and (line.startswith("G0") or line.startswith("G1")):
                            processed_line = process_line(line.strip())
                            first_xy_lines.append([processed_line])
                            found_first_xy_line = True

        # Append the last layers if they exist
        if current_layer:
            regular_layers.append(current_layer)
        if current_nonmesh:
            nonmesh_layers.append(current_nonmesh)
        elif current_layer:  # Append an empty list if the last layer has no nonmesh part
            nonmesh_layers.append([])

    except Exception as e:
        print(f"Error reading file: {e}")
        return None, None, None, None

    # Check for empty sections and replace with an empty list
    regular_layers_tree = th.list_to_tree(regular_layers if regular_layers else [[]])
    nonmesh_layers_tree = th.list_to_tree(nonmesh_layers if nonmesh_layers else [[]])
    first_xy_tree = th.list_to_tree(first_xy_lines if first_xy_lines else [[]])

    return header, regular_layers_tree, footer, nonmesh_layers_tree, first_xy_tree

def process_line(line):
    parts = line.split()
    filtered_parts = [part for part in parts if part not in ['G0', 'G1'] and not part.startswith('F') and not part.startswith('E')]
    return ' '.join(filtered_parts)

# Usage
# Replace 'filePath' with the actual file path

header, regular_layers, footer, nonmesh_layers, first_xy_lines = split_gcode_into_header_layers_footer(filePath)
# ---------- end separate_gcode ----------
separate_gcode_2 = Script(filePath=filepath)  # -> out, simplify(zPerLayer)
# ---------- separate_gcode_2: Python ----------
import rhinoscriptsyntax as rs
import Rhino.Geometry as rg
import ghpythonlib.treehelpers as th

def read_gcode_and_extract_z_values(file_path):
    z_values = {}
    current_z = None
    g0_z = None
    new_layer = False

    with open(file_path, 'r') as file:
        for line in file:
            if line.startswith(';LAYER:'):
                current_layer = int(line.split(':')[1])
                new_layer = True
            elif line.startswith('G0') and 'Z' in line:
                parts = line.split(' ')
                for part in parts:
                    if part.startswith('Z'):
                        g0_z = float(part[1:])
            elif line.startswith('G1') and new_layer:
                if g0_z is not None:
                    current_z = g0_z
                z_values[current_layer] = current_z
                new_layer = False

    return z_values

def create_grasshopper_tree(z_values):
    layers = sorted(z_values.keys())
    tree_data = [[z_values[layer]] for layer in layers]
    return th.list_to_tree(tree_data)

# Example usage

z_values = read_gcode_and_extract_z_values(filePath)
zPerLayer = create_grasshopper_tree(z_values)
# ---------- end separate_gcode_2 ----------
header = ClusterOutput(separate_gcode.header)
regular_layers = ClusterOutput(separate_gcode.regular_layers)
nonmesh_layers = ClusterOutput(separate_gcode.nonmesh_layers)
footer = ClusterOutput(separate_gcode.footer)
first_xy_lines = ClusterOutput(separate_gcode.first_xy_lines)
tree_statistics = TreeStatistics(Tree=separate_gcode_2.zPerLayer)  # -> Paths, Length, Count
list_item = ListItem(List=flatten(separate_gcode_2.zPerLayer), Index=1, Wrap=True)
division = Division(A=list_item, B=2)
split_list = SplitList(List=tree_statistics.Paths, Index=1)  # -> ListA, ListB
split_tree = SplitTree(Data=separate_gcode_2.zPerLayer, Masks=flatten(split_list.ListB))  # -> Positive, Negative
merge = Merge(Data1=division, Data2=split_tree.Positive)
zperlayer = ClusterOutput(merge)

# ==== cluster IroningPoints
gcode_tree = ClusterInput()
z_tree = ClusterInput()
sampling_length = ClusterInput()

# ---- group: Ironing points
S = Script(gcode_tree=simplify(gcode_tree), z_tree=simplify(z_tree))  # -> out, A; inputs gcode_tree: tree of String, z_tree: tree of Double
# ---------- S: C# ----------
using System;
using System.Collections.Generic;
using Rhino.Geometry;
using Grasshopper;
using Grasshopper.Kernel.Data;

public class Script_Instance : GH_ScriptInstance
{
    private void RunScript(
	DataTree<string> gcode_tree,
	DataTree<double> z_tree,
	ref object A)
    {
        var outputTree = new DataTree<Point3d>();
        var lastCoords = new Dictionary<string, double>
        {
            {"X", 0.0},
            {"Y", 0.0}
        };

        for (int i = 0; i < gcode_tree.BranchCount; i++)
        {
            var layer = gcode_tree.Branch(i);
            var zValue = z_tree.Branch(i)[0]; // Assuming each Z tree branch has exactly one item
            var path = gcode_tree.Path(i); // Get the path to ensure correct tree structure in the output
            var result = ProcessLayer(layer, zValue, lastCoords);
            var points = result.Item1;
            lastCoords = result.Item2;

            outputTree.AddRange(points, path);
        }

        A = outputTree;
    }

    // <Custom additional code> 

private Tuple<List<Point3d>, Dictionary<string, double>> ProcessLayer(List<string> layer, double zValue, Dictionary<string, double> lastCoords)
{
    var points = new List<Point3d>();
    bool isWallOuter = false;

    foreach (var line in layer)
    {
        if (line.StartsWith(";TYPE:WALL-OUTER"))
        {
            isWallOuter = true; // Start recording points when WALL-OUTER is encountered
            continue;
        }
        if (line.StartsWith(";TYPE:") && isWallOuter)
        {
            isWallOuter = false; // Stop recording points when the next TYPE is encountered but keep looking for other WALL-OUTER sections
            continue;
        }

        if (isWallOuter && line.StartsWith("G1"))
        {
            lastCoords = ExtractCoordinates(line, lastCoords);
            // Check to ensure we don't add the point (0,0)
            if (lastCoords["X"] != 0.0 || lastCoords["Y"] != 0.0)
            {
                var point = new Point3d(lastCoords["X"], lastCoords["Y"], zValue);
                points.Add(point);
            }
        }
    }
    return new Tuple<List<Point3d>, Dictionary<string, double>>(points, lastCoords);
}



    private Dictionary<string, double> ExtractCoordinates(string line, Dictionary<string, double> lastCoords)
    {
        var coords = new Dictionary<string, double>(lastCoords);
        var parts = line.Split(' ');

        foreach (var part in parts)
        {
            if (part.StartsWith("X"))
                coords["X"] = double.Parse(part.Substring(1));
            else if (part.StartsWith("Y"))
                coords["Y"] = double.Parse(part.Substring(1));
        }

        return coords;
    }
}
# ---------- end S ----------
pline = PolyLine(Vertices=S.A, Closed=True)
divlength = DivideLength(Curve=pline, SamplingLength=sampling_length)  # -> Points, Tangents, Parameters
pt = Point(simplify(divlength.Points))

# ----
pt_2 = ClusterOutput(pt)

# ==== cluster ImageProjection
projectedimagepath = ClusterInput()
method = ClusterInput()
minx = ClusterInput()
points = ClusterInput()
maxx = ClusterInput()
minz = ClusterInput()
maxz = ClusterInput()
stream_gate = StreamGate(Stream=points, Method=method)  # -> Target0, Target1
stream_gate_2 = StreamGate(Projectedimagepath=projectedimagepath, Method=method)  # -> Target0, Target1
subtraction = Subtraction(MaxX=maxx, MinX=minx)
subtraction_2 = Subtraction(MaxZ=maxz, MinZ=minz)

# ---- group: Image projection
pdecon = Deconstruct(Point=stream_gate.Target0)  # -> XComponent, YComponent, ZComponent
subtraction_3 = Subtraction(A=pdecon.XComponent, MinX=minx)
subtraction_4 = Subtraction(A=pdecon.ZComponent, MinZ=minz)
division = Division(A=subtraction_4, B=subtraction_2)
division_2 = Division(A=subtraction_3, B=subtraction)
pt = ConstructPoint(XCoordinate=division_2, YCoordinate=division, ZCoordinate=0)
stream_gate_3 = StreamGate(Stream=pt, Method=method)  # -> Target0, Target1
imagesampler = Script(imagePath=stream_gate_2.Target0, pointsZ=stream_gate_3.Target0)  # -> out, A; inputs imagePath: String, pointsZ: tree of Point3d
# ---------- imagesampler: C# ----------
using System;
using System.Drawing;
using Grasshopper.Kernel;
using Grasshopper.Kernel.Data;
using Grasshopper.Kernel.Types;
using Rhino.Geometry; // For Point3d
using System.Collections.Generic;

public class Script_Instance : GH_ScriptInstance
{
   private void RunScript(
	string imagePath,
	Grasshopper.DataTree<Rhino.Geometry.Point3d> pointsZ,
	ref object A)
  {
    // Validate the image path
    if (!System.IO.File.Exists(imagePath))
    {
      this.AddRuntimeMessage(GH_RuntimeMessageLevel.Error, "Image file does not exist at the specified path.");
      return;
    }

    // Load the image
    Bitmap image = new Bitmap(imagePath);
    int imageWidth = image.Width;
    int imageHeight = image.Height;

    // Prepare the output structure for lightness values
    GH_Structure<GH_Number> lightnessValues = new GH_Structure<GH_Number>();

    // Iterate through all the branches of the input tree
    for (int i = 0; i < pointsZ.BranchCount; i++)
    {
      var pointBranch = pointsZ.Branches[i];
      var lightnessBranch = new List<GH_Number>();
      GH_Path path = new GH_Path(i);

      foreach (Point3d point in pointBranch)
      {
        // Use the X and Y coordinates, scaling them to the image size
        double scaledX = point.X * (imageWidth - 1);
        double scaledY = point.Y * (imageHeight - 1);

        // Ensure coordinates are within the image boundaries
        scaledX = Math.Max(0, Math.Min(scaledX, imageWidth - 1));
        scaledY = Math.Max(0, Math.Min(scaledY, imageHeight - 1));

        // Sample the image
        Color pixelColor = image.GetPixel((int)scaledX, (int)((imageHeight-1)-scaledY));
        float lightness = pixelColor.GetBrightness(); // Returns a float from 0 to 1

        // Add the lightness value to the branch
        lightnessBranch.Add(new GH_Number(lightness));
      }

      // Add the branch to the output structure
      lightnessValues.AppendRange(lightnessBranch, path);
    }

    // Set the output
    A = lightnessValues;
  }
}
# ---------- end imagesampler ----------

# ----
A = ClusterOutput(imagesampler.A)

# ==== cluster OBJTexture
_3mfpath = ClusterInput()
objpath = ClusterInput()
method = ClusterInput()
stream_gate = StreamGate(_3MFPath=_3mfpath, Method=method)  # -> Target0, Target1
stream_gate_2 = StreamGate(OBJPath=objpath, Method=method)  # -> Target0, Target1
inputpointsinput = ClusterInput()
texturepath = ClusterInput()

# ---- group: when using OBJ
_3mfpath_2 = FilePath(stream_gate.Target1)
texturepath_2 = FilePath(texturepath)
objpath_2 = FilePath(stream_gate_2.Target1)

# ---- group: OBJ texture / OBJ file processing
getmesh_and_uv = Script(obj_file_path=objpath_2)  # -> out, face_uvs_gh_tree, gh_mesh_output; inputs obj_file_path: String
# ---------- getmesh_and_uv: Python ----------
import Rhino.Geometry as rg
import re
import System.Drawing as Drawing
import ghpythonlib.treehelpers as th

# Function to read the OBJ file and extract vertices, faces, and their corresponding UV coordinates
def load_obj_for_grasshopper_mesh(obj_file_path):
    vertices = []
    faces = []
    uvs = []
    face_uvs_tree = []  # Prepare for Grasshopper tree structure

    with open(obj_file_path, 'r') as file:
        face_counter = 0  # Keep track of face indices
        for line in file:
            if line.startswith('v '):
                parts = line.strip().split()
                vertices.append(rg.Point3d(float(parts[1]), float(parts[2]), float(parts[3])))
            elif line.startswith('vt '):
                parts = line.strip().split()
                uvs.append(rg.Point2d(float(parts[1]), float(parts[2])))
            elif line.startswith('f '):
                vertex_indices = []
                uv_indices = []
                parts = line.strip().split()[1:]
                for part in parts:
                    indices = re.split(r'\/+', part)
                    vertex_index = int(indices[0]) - 1
                    uv_index = int(indices[1]) - 1 if len(indices) > 1 and indices[1] else None
                    vertex_indices.append(vertex_index)
                    uv_indices.append(uv_index)
                
                # Check if it's a triangle or quad and assign faces accordingly
                if len(vertex_indices) == 3:
                    faces.append(rg.MeshFace(vertex_indices[0], vertex_indices[1], vertex_indices[2]))
                    face_uvs_tree.append([uvs[uv_indices[0]], uvs[uv_indices[1]], uvs[uv_indices[2]]])
                elif len(vertex_indices) == 4:
                    faces.append(rg.MeshFace(vertex_indices[0], vertex_indices[1], vertex_indices[2], vertex_indices[3]))
                    face_uvs_tree.append([uvs[uv_indices[0]], uvs[uv_indices[1]], uvs[uv_indices[2]], uvs[uv_indices[3]]])

                # Increment the face counter to track face indices
                face_counter += 1

    # Convert to Grasshopper Data Tree
    face_uvs_gh_tree = th.list_to_tree(face_uvs_tree)

    return vertices, faces, face_uvs_gh_tree


vertices, faces, face_uvs_gh_tree = load_obj_for_grasshopper_mesh(obj_file_path)

# Create a Grasshopper mesh
gh_mesh = rg.Mesh()
for v in vertices:
    gh_mesh.Vertices.Add(v)
for f in faces:
    gh_mesh.Faces.AddFace(f)
gh_mesh.Normals.ComputeNormals()

# Outputs
a = vertices  # List of vertices
b = face_uvs_gh_tree  # Grasshopper tree of UV coordinates, each branch corresponds to a face
gh_mesh_output = gh_mesh  # Grasshopper mesh
# ---------- end getmesh_and_uv ----------

# ----
_3mf_data = _3MFData(zipfilepath=_3mfpath_2)
maxx = ClusterInput()
maxy = ClusterInput()
maxz = ClusterInput()
minx = ClusterInput()
miny = ClusterInput()
minz = ClusterInput()
pt = ConstructPoint(XCoordinate=maxx, YCoordinate=maxy, ZCoordinate=maxz)
pt_2 = ConstructPoint(XCoordinate=minx, YCoordinate=miny, ZCoordinate=minz)

# ---- group: OBJ texture / move mesh to gcode position
pi = Pi(Factor=1)
yz = YZPlane(Origin=Point(0, 0, 0))
multiplication = Multiplication(A=pi, B=Slider(1.5, range=0..10))
rotate = Rotate(Geometry=getmesh_and_uv.gh_mesh_output, Angle=multiplication, Plane=yz)  # -> Geometry, Transform
transform = Transform(Geometry=rotate.Geometry, Transform=_3mf_data)
box = Box2Pt(PointA=pt_2, PointB=pt, Plane=PlaneXY(0, 0, 0))
bbox = BoundingBox(Content=transform, Plane=PlaneXY(0, 0, 0))  # -> Box, Box_2
bbox_2 = BoundingBox(Content=box, Plane=PlaneXY(0, 0, 0))  # -> Box, Box_2
box_corners = BoxCorners(Box=bbox.Box)  # -> CornerA, CornerB, CornerC, CornerD, CornerE, CornerF, CornerG, CornerH
box_corners_2 = BoxCorners(Box=bbox_2.Box)  # -> CornerA, CornerB, CornerC, CornerD, CornerE, CornerF, CornerG, CornerH
vec2pt = Vector2Pt(PointA=box_corners.CornerE, PointB=box_corners_2.CornerE, Unitize=False)  # -> Vector, Length
move = Move(Geometry=transform, Motion=vec2pt.Vector)  # -> simplify(Geometry), Transform

# ----
working = Script(
    meshInput=simplify(move.Geometry),
    uv_treeInput=simplify(getmesh_and_uv.face_uvs_gh_tree),
    inputPointsInput=simplify(inputpointsinput),
    textureFilePathInput=simplify(texturepath_2))  # -> out, simplify(Grayscale); inputs uv_treeInput: tree, inputPointsInput: tree
# ---------- working: C# ----------
using System;
using System.Drawing;
using Rhino.Geometry;
using Grasshopper;
using Grasshopper.Kernel;
using Grasshopper.Kernel.Data;
using Grasshopper.Kernel.Types;
using System.Collections.Generic;
using System.Drawing.Imaging;
using System.Runtime.InteropServices;

public class Script_Instance : GH_ScriptInstance
{
    private void RunScript(
	object meshInput,
	DataTree<object> uv_treeInput,
	DataTree<object> inputPointsInput,
	object textureFilePathInput,
	ref object Grayscale)
    {
        Mesh mesh = meshInput as Mesh;
        if (mesh == null)
        {
            AddRuntimeMessage(GH_RuntimeMessageLevel.Error, "Invalid mesh input.");
            return;
        }

        DataTree<object> uv_tree = uv_treeInput as DataTree<object>;
        if (uv_tree == null)
        {
            AddRuntimeMessage(GH_RuntimeMessageLevel.Error, "Invalid UV tree input.");
            return;
        }

        DataTree<double> grayscaleOutput = new DataTree<double>();

        string textureFilePath = textureFilePathInput as string;
        if (string.IsNullOrEmpty(textureFilePath))
        {
            AddRuntimeMessage(GH_RuntimeMessageLevel.Error, "Invalid texture file path.");
            return;
        }

        // Pre-process UV data: Ensure UV indices are mapped correctly to face indices
        Dictionary<int, List<Point2d>> faceUvMap = new Dictionary<int, List<Point2d>>();
        foreach (GH_Path path in uv_tree.Paths)
        {
            int faceIndex = path.Indices[0];
            List<Point2d> faceUvPoints = new List<Point2d>();

            foreach (var obj in uv_tree.Branch(path))
            {
                if (obj is Point2d uv)
                    faceUvPoints.Add(uv);
                else if (obj is GH_Point ghPt)
                    faceUvPoints.Add(new Point2d(ghPt.Value.X, ghPt.Value.Y));
                else if (obj is Point3d pt)
                    faceUvPoints.Add(new Point2d(pt.X, pt.Y));
                else
                {
                    AddRuntimeMessage(GH_RuntimeMessageLevel.Warning, $"Invalid UV point at face index {faceIndex}.");
                    continue;
                }
            }
            faceUvMap[faceIndex] = faceUvPoints;
        }

        // Load texture and prepare for fast pixel access
        using (Bitmap texture = new Bitmap(textureFilePath))
        using (FastBitmap fastBitmap = new FastBitmap(texture))
        {
            // Process each branch of input points
            for (int i = 0; i < inputPointsInput.Paths.Count; i++)
            {
                GH_Path path = inputPointsInput.Paths[i];
                List<Point3d> pointsInLayer = new List<Point3d>();

                foreach (var item in inputPointsInput.Branch(path))
                {
                    if (item is Point3d pt)
                        pointsInLayer.Add(pt);
                    else if (item is GH_Point ghPt)
                        pointsInLayer.Add(ghPt.Value);
                    else
                    {
                        AddRuntimeMessage(GH_RuntimeMessageLevel.Error, "Invalid input point.");
                        return;
                    }
                }

                // Process points within the layer using the main mesh
                for (int j = 0; j < pointsInLayer.Count; j++)
                {
                    Point3d inputPoint = pointsInLayer[j];

                    // Use Rhino's ClosestMeshPoint to find the nearest point on the mesh
                    MeshPoint meshPoint = mesh.ClosestMeshPoint(inputPoint, double.MaxValue);

                    if (meshPoint != null)
                    {
                        int closestFaceIndex = meshPoint.FaceIndex;
                        MeshFace closestFace = mesh.Faces[closestFaceIndex];

                        // Use UVs from the face UV map
                        if (faceUvMap.TryGetValue(closestFaceIndex, out List<Point2d> faceUvPoints))
                        {
                            // Use barycentric coordinates from MeshPoint.T
                            double[] baryCoords = new double[meshPoint.T.Length];
                            meshPoint.T.CopyTo(baryCoords, 0);

                            // Interpolate UV coordinates
                            Point2d interpolatedUv = InterpolateUv(faceUvPoints, baryCoords);

                            // Get color from texture at UV and convert to grayscale
                            Color colorAtUv = GetColorFromTextureAtUv(fastBitmap, interpolatedUv);
                            double grayscale = 1 - (colorAtUv.R * 0.299 + colorAtUv.G * 0.587 + colorAtUv.B * 0.114) / 255;

                            grayscaleOutput.Add(grayscale, path);
                        }
                    }
                    else
                    {
                        grayscaleOutput.Add(0, path);  // Fallback for points that couldn't find a valid face
                    }
                }
            }

            // Assign outputs
            Grayscale = grayscaleOutput;
        }
    }

    // Interpolating UVs using barycentric coordinates
    private Point2d InterpolateUv(List<Point2d> uvs, double[] baryCoords)
    {
        double u = 0, v = 0;
        for (int i = 0; i < uvs.Count; i++)
        {
            u += uvs[i].X * baryCoords[i];
            v += uvs[i].Y * baryCoords[i];
        }
        return new Point2d(u, v);
    }

    // Helper functions
    private Color GetColorFromTextureAtUv(FastBitmap texture, Point2d uv)
    {
        int u = Math.Max(Math.Min((int)(uv.X * texture.Width), texture.Width - 1), 0);
        int v = Math.Max(Math.Min((int)((1 - uv.Y) * texture.Height), texture.Height - 1), 0);
        return texture.GetPixel(u, v);
    }
}

// FastBitmap class for quick pixel access
public class FastBitmap : IDisposable
{
    private Bitmap bitmap;
    private BitmapData bitmapData;
    private byte[] pixelBuffer;
    private int bytesPerPixel;
    private int heightInPixels;
    private int widthInPixels;
    private int stride;

    public FastBitmap(Bitmap bitmap)
    {
        this.bitmap = bitmap;
        Rectangle rect = new Rectangle(0, 0, bitmap.Width, bitmap.Height);
        bitmapData = bitmap.LockBits(rect, ImageLockMode.ReadOnly, bitmap.PixelFormat);

        bytesPerPixel = Image.GetPixelFormatSize(bitmap.PixelFormat) / 8;
        stride = bitmapData.Stride;
        heightInPixels = bitmapData.Height;
        widthInPixels = bitmapData.Width;
        int byteCount = stride * heightInPixels;
        pixelBuffer = new byte[byteCount];
        Marshal.Copy(bitmapData.Scan0, pixelBuffer, 0, byteCount);
    }

    public Color GetPixel(int x, int y)
    {
        int position = y * stride + x * bytesPerPixel;

        byte b = pixelBuffer[position];
        byte g = pixelBuffer[position + 1];
        byte r = pixelBuffer[position + 2];
        byte a = bytesPerPixel == 4 ? pixelBuffer[position + 3] : (byte)255;

        return Color.FromArgb(a, r, g, b);
    }

    public int Width => widthInPixels;
    public int Height => heightInPixels;

    public void Dispose()
    {
        bitmap.UnlockBits(bitmapData);
    }
}
# ---------- end working ----------

# ---- group: OBJ texture
subtraction = Subtraction(A=Slider(1, range=0..1), B=working.Grayscale)  # -> simplify(Result)

# ----
R = ClusterOutput(subtraction)

# ==== cluster _3MFData
zipfilepath = ClusterInput()
S = Script(zipFilePath=zipfilepath)  # -> out, A; inputs zipFilePath: String
# ---------- S: C# ----------
// Grasshopper Script Instance
using System;
using System.Collections;
using System.Collections.Generic;
using System.Drawing;

using Rhino;
using Rhino.Geometry;

using Grasshopper;
using Grasshopper.Kernel;
using Grasshopper.Kernel.Data;
using Grasshopper.Kernel.Types;
using System.IO;
using System.IO.Compression;

public class Script_Instance : GH_ScriptInstance
{
  /* 
    Members:
      RhinoDoc RhinoDocument
      GH_Document GrasshopperDocument
      IGH_Component Component
      int Iteration

    Methods (Virtual & overridable):
      Print(string text)
      Print(string format, params object[] args)
      Reflect(object obj)
      Reflect(object obj, string method_name)
  */
  
 private void RunScript(string zipFilePath, ref object A)
{
  string jsonContent = "";

  try
  {
    // Check if the file exists
    if (!File.Exists(zipFilePath))
    {
      throw new FileNotFoundException("Zip file not found.");
    }

    // Open the zip archive
    using (ZipArchive archive = ZipFile.OpenRead(zipFilePath))
    {
      // Find the entry for the ultimaker3.def.json file
      ZipArchiveEntry entry = archive.GetEntry("3D/3dmodel.model");

      if (entry != null)
      {
        // Open a stream to read the file
        using (StreamReader reader = new StreamReader(entry.Open()))
        {
          // Read the content of the file
          jsonContent = reader.ReadToEnd();
        }
      }
      else
      {
        throw new FileNotFoundException("file not found in the zip.");
      }
    }
  }
  catch (Exception ex)
  {
    // Handle exceptions (e.g., file not found, invalid zip file)
    jsonContent = "Error: " + ex.Message;
  }

  A = jsonContent;
}
}
# ---------- end S ----------
S_2 = Script(xmlInput=S.A)  # -> out, A; inputs xmlInput: String
# ---------- S_2: C# ----------
// Grasshopper Script Instance
using System;
using System.Collections;
using System.Collections.Generic;
using System.Drawing;

using Rhino;
using Rhino.Geometry;

using Grasshopper;
using Grasshopper.Kernel;
using Grasshopper.Kernel.Data;
using Grasshopper.Kernel.Types;
using System.Xml;
using Rhino.Geometry;
using System.Globalization;
using System;
using System.Xml;
using System.IO;
using Rhino.Geometry;
using System.Globalization;

public class Script_Instance : GH_ScriptInstance
{
  /* 
    Members:
      RhinoDoc RhinoDocument
      GH_Document GrasshopperDocument
      IGH_Component Component
      int Iteration

    Methods (Virtual & overridable):
      Print(string text)
      Print(string format, params object[] args)
      Reflect(object obj)
      Reflect(object obj, string method_name)
  */
  

private void RunScript(object x, string xmlInput, ref object A)
{
    XmlDocument doc = new XmlDocument();

    // Load XML with namespaces
    NameTable nt = new NameTable();
    XmlNamespaceManager nsmgr = new XmlNamespaceManager(nt);
    nsmgr.AddNamespace("m", "http://schemas.microsoft.com/3dmanufacturing/core/2015/02");

    XmlParserContext context = new XmlParserContext(null, nsmgr, null, XmlSpace.None);
    XmlReaderSettings settings = new XmlReaderSettings
    {
        NameTable = nt
    };

    XmlReader reader = XmlReader.Create(new StringReader(xmlInput), settings, context);
    doc.Load(reader);

    // Select the 'item' node with the 'transform' attribute
    XmlNode itemNode = doc.SelectSingleNode("//m:item[@transform]", nsmgr);

    if (itemNode == null)
    {
        A = "Transform attribute not found";
        return;
    }

    // Extract the transform attribute
    string transformString = itemNode.Attributes["transform"].Value;
    string[] parts = transformString.Split(' ');
    if (parts.Length != 12)
    {
        A = "Invalid transform format";
        return;
    }

    // Convert to 3x4 matrix
    double[,] matrix = new double[3, 4];
    for (int i = 0; i < 3; i++)
    {
        for (int j = 0; j < 4; j++)
        {
            matrix[i, j] = Convert.ToDouble(parts[i * 4 + j], CultureInfo.InvariantCulture);
        }
    }

    A = matrix;
}


}
# ---------- end S_2 ----------
matrix = ConstructMatrix(Rows=4, Columns=3, Values=S_2.A)
unresolved_proxy = ClusterOutput(<missing>)
